vi "VISA Serial Simple Query.gvi"   [LabVIEW NXG 5.1.0]
panel controls:
  "VISA Resource Name": "VISA Instr" = "COM1"
    # A string that uniquely identifies the resource to be opened and
    # written to as well as read from. The grammar for the resource name is
    # shown below.  Optional string segments are shown in square brackets ([])
    # Interface&emspSyntax
    # VXI              VXI[board]::VXI logical address[::INSTR]
    # GPIB-VXI     GPIB-VXI[board]::VXI logical address[::INSTR]
    # GPIB&emsp          GPIB[board]::primary address[::secondary address][::INSTR]
    # Serial&emsp          ASRL[board][::INSTR]
    # The following table shows the default value for optional string segments.
    # Optional String Segments            Default Value
    # board                                           0
    # secondary address&emsp                      none
    # The following table shows examples of address strings.
    # Address String&emsp   Description
    # VXI0::1&emsp              A VXI device at logical address 1 in VXI interface VXI0.
    # GPIB-VXI::9&emsp      A VXI device at logical address 9 in a GPIB-VXI controlled system.
    # GPIB::5&emsp             A GPIB device at primary address 5.
    # ASRL1&emsp              A serial device attached to interface ASRL1.
  "Delay Before Read": u32 = 500
  "Serial Settings": T1 = {"baud rate"=9600, "data bits"=8, "parity"="None", "stop bits"=10, "flow control"=0}
  "Stop": bool
panel indicators:
  "Response": string
  "Bytes Read": u32
types:
  T1 = cluster{"baud rate": u32, "data bits": u16, "parity": enum{"None", "Odd", "Even", "Mark", "Space"}, "stop bits": u16, "flow control": u16}
uses:
  NI::VISA::Open (Instr).gvi
  NI::VISA::Configure Serial Port (Instr).gvi
  NI::VISA::Write (Instr, String).gvi
  NI::VISA::Read (Instr, String).gvi
  NI::VISA::Close (Instr).gvi
  NI::G Core::Error::Display Error.gvi
diagram:
  Property Node(instance in=$"Serial Settings") -> ("baud rate"=w1, "data bits"=w2, "parity"=w3, "stop bits"=w4, "flow control"=w5)
  call "Open (Instr).gvi"(resource name=$"VISA Resource Name") -> (session out=w6, error out=w7)
  call "Configure Serial Port (Instr).gvi"(stop bits=w4, flow control=w5, session in=w6, error in=w7, baud rate=w1, data bits=w2, parity=w3) -> (session out=w8, error out=w9)
  # Use the VISA Configure Serial Port VI to configure the serial port. Send the "*IDN?" command with the VISA Write function. Read the response from the instrument with the VISA Read function. Note that the "Bytes at Port" property is used to determine how much data to read. For a single read use case, this is acceptable. For a continuous serial read, a more general approach is recommended. For an example of how to perform continuous serial communication in a loop, take a look at the VISA Serial Continuous Write and Read example.
  while {
    call "Write (Instr, String).gvi"(session in=w8, error in=w9, write buffer="ok?\n") -> (session out=w10, error out=w11)
    w12 = $"Delay Before Read"
    sequence {
      frame 0 {
        Wait(time to wait=w12)
      }
    }
    Property Node(instance in=w10, error in=w11) -> ("ASRL Bytes at Port"=w13, error out=w14, instance out=w15)
    call "Read (Instr, String).gvi"(session in=w15, error in=w14, byte count=w13) -> (session out=w16, error out=w17, read buffer=w18)
    $Response <- w18
    $"Bytes Read" <- w13
    stop if $Stop
  }
  call "Close (Instr).gvi"(session in=w16, error in=w17) -> (error out=w19)
  call "Display Error.gvi"(error in=w19)
